vi "Main.gviweb"   [G Web Development Software 21.0.0]
panel controls:
  "stop": bool
  "log": bool
  "Slider": i32
panel indicators:
  "value": bool
  "Chart": i32
  "Array": i32[]
uses:
  WebApp::Function.gvi
diagram:
  Obtain Queue(element data type=i32 0, name="UI") -> (error out=w1, queue out=w2)
  # Place setup code before the loop. For example, perform initial data communication and wire the results into the loop.
  # Top-Level WebVIs usually contain a While Loop that never stops so that they can continue running as long as the web page is open in the user's web browser.
  s1 = FALSE  # shift register
  s2 = w2  # shift register
  while (iteration -> i1) {
    Not(x=s1) -> w3
    call "Function.gvi"(x=i1) -> (remainder=w4)
    Is Equal To 0(x=w4) -> w5
    Select(s=w5, t=w3, f=s1) -> w6
    $value <- w6
    $Chart <- w4
    Enqueue Element(element=w4, error in=w1, queue=s2) -> (error out=w7, queue out=w8)
    Wait(time to wait=50)
    next s1 = w6
    next s2 = w8
    stop if FALSE
  }
  Flush Queue(error in=w7, queue=s2)
  s3 = i32[] []  # shift register
  while {
    Dequeue Element(error in=w1, queue=w2) -> (element=w9, error out=w10, queue out=w11)
    case ($log) {
      frame False, Default {
        Build Array(s3, $Slider) -> w13
        w12 = w10
      }
      frame True {
        Build Array(s3, w9) -> w13
        w12 = w10
      }
    }
    $Array <- w13
    next s3 = w13
    stop if $stop
  }
